# Grasshopper definition S_0(Folded).gh (Grasshopper 0.9.56)

number_slider = Slider(0, range=0..2)
pi = Pi(Factor=1)
acos = ArcCosine(Value=0.3333333333)
subtraction = Subtraction(A=pi, B=acos)
s_0_t_0 = Surface(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)
s_0_t_2 = Surface(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)
s_0_t_1 = Surface(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)
s_0_t_3 = Surface(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)
rotax = RotateAxis(Geometry=s_0_t_0, Angle=number_slider, Axis=Line((6.999715151, -4.185936767, 0), (-0.1162760213, 8.139321491, 0)))  # -> Geometry, Transform
rotax_2 = RotateAxis(Geometry=s_0_t_1, Angle=number_slider, Axis=Line((14.11570632, 8.139321491, 0), (6.999715151, -4.185936767, 0)))  # -> Geometry, Transform
rotax_3 = RotateAxis(Geometry=s_0_t_2, Angle=number_slider, Axis=Line((-0.1162760213, 8.139321491, 0), (14.11570632, 8.139321491, 0)))  # -> Geometry, Transform
