# Grasshopper definition S_1(Folded_Test).gh (Grasshopper 0.9.56)

number_slider = Slider(1.913, range=0..1.913)
t_00 = Surface(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)
t_01 = Surface(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)
t_02 = Surface(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)
t_03 = Surface(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)
t_10 = Surface(<surface referenced from the Rhino model>)
t_11 = Surface(<surface referenced from the Rhino model>)
t_12 = Surface(<surface referenced from the Rhino model>)
t_13 = Surface(<surface referenced from the Rhino model>)
t_20 = Surface(<surface referenced from the Rhino model>)
t_21 = Surface(<surface referenced from the Rhino model>)
t_22 = Surface(<surface referenced from the Rhino model>)
t_23 = Surface(<surface referenced from the Rhino model>)
t_30 = Surface(<surface referenced from the Rhino model>)
t_31 = Surface(<surface referenced from the Rhino model>)
t_32 = Surface(<surface referenced from the Rhino model>)
t_33 = Surface(<surface referenced from the Rhino model>)
rotax = RotateAxis(Geometry=t_03, Angle=number_slider, Axis=Line((14.11570632, 8.139321491, 0), (-0.1162760213, 8.139321491, 0)))  # -> Geometry, Transform
rotax_2 = RotateAxis(Geometry=t_13, Angle=number_slider, Axis=Line((14.11570632, 8.139321491, 0), (-0.1162760213, 8.139321491, 0)))  # -> Geometry, Transform
rotax_3 = RotateAxis(Geometry=t_23, Angle=number_slider, Axis=Line((28.34768867, 32.78983801, 0), (14.11570632, 32.78983801, 0)))  # -> Geometry, Transform
rotax_4 = RotateAxis(Geometry=t_33, Angle=number_slider, Axis=Line((14.11570632, 8.139321491, 0), (28.34768867, 8.139321491, 0)))  # -> Geometry, Transform
X = Axis(Line((35.46367984, 20.46457975, 0), (21.2316975, -4.185936767, 0)))
X_2 = Axis(Line((21.2316975, -4.185936767, 0), (6.999715151, 20.46457975, 0)))
X_3 = Axis(Line((6.999715151, 20.46457975, 0), (35.46367984, 20.46457975, 0)))
rotax_5 = RotateAxis(Geometry=[t_00, t_01, t_02], Angle=number_slider, Axis=X_2)  # -> Geometry, Transform
rotax_6 = RotateAxis(Geometry=rotax.Geometry, Angle=number_slider, Axis=X_2)  # -> Geometry, Transform
rotax_7 = RotateAxis(Geometry=[t_11, t_10, t_12], Angle=number_slider, Axis=X)  # -> Geometry, Transform
rotax_8 = RotateAxis(Geometry=rotax_2.Geometry, Angle=number_slider, Axis=X)  # -> Geometry, Transform
rotax_9 = RotateAxis(Geometry=[t_21, t_20, t_22], Angle=number_slider, Axis=X_3)  # -> Geometry, Transform
rotax_10 = RotateAxis(Geometry=rotax_3.Geometry, Angle=number_slider, Axis=X_3)  # -> Geometry, Transform
